# Grasshopper definition Spiral.gh (Grasshopper 1.0.7)

trigger = Trigger(Interval=10, TimerInterval=10, Target=python)
python = GhPythonScript(start=Toggle(True))  # -> out, a, b, c
# ---------- python: Python ----------
from scriptcontext import sticky
import math


if start == True:
    sticky["x"] = 0
    sticky["y"] = 0
    sticky["z"] = 0
else:
    sticky["x"] = sticky["x"] + 0.1
    sticky["y"] = sticky["y"] + 0.1
    sticky["z"] = sticky["z"] + 0.1

a = 10*math.cos(sticky["x"])
b = 10*math.sin(sticky["y"])
c = sticky["z"]
# ---------- end python ----------
python_2 = GhPythonScript()  # -> Out, A
panel = Panel(python.out)
pt = ConstructPoint(XCoordinate=python.a, YCoordinate=python.b, ZCoordinate=python.c)
sph = Sphere(Base=pt, Radius=1)
rec = DataRecorder(sph, DataLimit=-10, RecordData=True)
